% Simulink data dictionary DataDictionary.sldd

designSplineTotal = Simulink.Bus()
  designSpline1: Bus: designSpline1
  designSpline2: Bus: designSpline2

keyEventTotal = Simulink.Bus()
  KeyEvent2: Bus: keyEvent2
  KeyEvent1: Bus: keyEvent1

keyEventsAmount = 20

keyEvent2 = Simulink.Bus()
  keyEvent2Number: double
  keyEvent2Phase: double[20]
  keyEvent2y: double[20]
  keyEvent2dy: double[20]

keyEvent1 = Simulink.Bus()
  keyEvent1Number: double
  keyEvent1Phase: double[20]
  keyEvent1y: double[20]
  keyEvent1dy: double[20]

Sig = Simulink.Signal()
numberSamplePoints = 1000
Sig1 = Simulink.Signal()

designSpline1 = Simulink.Bus()
  f: double[1000]
  d: double[1000]
  s: double[1000]
  t: double[1000]

designSpline2 = Simulink.Bus()
  f: double[1000]
  d: double[1000]
  s: double[1000]
  t: double[1000]